# Grasshopper definition GHCitySim.ghx (Grasshopper 0.9.76)
# plug-ins: Python Interpreter

panel = Panel("C:\Users\peronato\Desktop\CitySimGH\")
brep = Brep([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])
path = FilePath("C:\Users\peronato\Documents\WeatherFiles\Neuchatel-hour.epw")
number_slider = Slider(10, range=0..10)
debrep = DeconstructBrep(Brep=brep)  # -> simplify(Faces), Edges, Vertices
epw_to_clim = Ladybug_EpwToClim(epwFile=path, path=panel, Run=Toggle(False))  # -> out, climatefile; plug-in component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
brep_2 = Brep(graft(debrep.Faces))
dim = Dimensions(Surface=brep_2)  # -> UDimension, VDimension
division = Division(A=dim.VDimension, B=Slider(2, range=0..10))
division_2 = Division(A=dim.UDimension, B=Slider(8, range=0..10))
mesh_uv = MeshSurface(Surface=brep_2, UCount=division_2, VCount=division, Overhang=False, Equalize=False)
faceb = FaceBoundaries(Mesh=mesh_uv)
path_mapper = PathMapper(faceb, source="{A;B;C}", target="{A}")
srf = Surface(simplify(graft(path_mapper)))
crv = Curve(srf)
tstat = TreeStatistics(Tree=crv)  # -> Paths, Length, Count
citysim_loadresults = Honeybee_CitySimLoadResults(path=panel, name="test", paths=tstat.Paths, Run=Toggle(True))  # -> SW; plug-in component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
citysim_runsimulation = Honeybee_CitySimRunSimulation(geometry=crv, path=panel, name="test", climatefile=epw_to_clim.climatefile, Solver="C:\CitySim.exe", Run=Toggle(False))  # plug-in component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
exportladybug = Ladybug_ExportLadybug(components="*", targetFolder="C:\Users\peronato\Documents\GitHub\GHCitySim", export=Toggle(False))  # -> readMe; plug-in component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
ma = MassAddition(Input=citysim_loadresults)  # -> Result, PartialResults
division_3 = Division(A=ma.Result, B=1000)
bnd = Bounds(Numbers=flatten(division_3))
ladybug = Ladybug_Ladybug()  # -> Vviiiiiiiiiizzz; plug-in component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
honeybee = Honeybee_Honeybee()  # -> Vviiiiiiiiiizzz; plug-in component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
dedomain = DeconstructDomain(Domain=bnd)  # -> Start, End
gradient = Gradient(
    LowerLimit=Slider(0, range=0..100),
    UpperLimit=dedomain.End,
    Parameter=division_3,
    stops=[0.26: RGB(0, 0, 255), 0.704: RGB(255, 255, 0), 1: RGB(255, 0, 0)])
preview = CustomPreview(Geometry=srf, Shader=gradient)
